# Dynamo graph Home.dyn (Dynamo 2.6.1.8786)

select_point_on_face = DSPointOnElementSelection()  # 1 picked in the model
watch = Watch(select_point_on_face)
select_edge = DSEdgeSelection()  # 1 picked in the model
endPoint = Curve.EndPoint(curve=select_edge)
startPoint = Curve.StartPoint(curve=select_edge)
X = Point.X(point=select_point_on_face)
select_point_on_face_2 = DSPointOnElementSelection()  # 1 picked in the model
watch_2 = Watch(select_point_on_face_2)
